# Grasshopper definition WeaselTestFile_1.gh (Grasshopper 1.0.8)
# plug-ins: Weasel

number_slider = Slider(4, range=0..10)
series = Series(Start=0, Step=1, Count=number_slider)  # -> graft(Series)
series_2 = Series(Start="9", Step=1, Count=number_slider)  # -> graft(Series)
series_3 = Series(Start=0, Step=1, Count=10)  # -> simplify(graft(Series))
tstat = TreeStatistics(Tree=series_2)  # -> Paths, Length, Count
path = ConstructPath(Indices=series_2)
replace = ReplacePaths(Data=series, Search=tstat.Paths, Replace=flatten(path))
brover = BranchOverride(OriginalTree=series_3, SecondTree=replace, AddUnmatchedBranches=Toggle(True))
panel = Panel(brover)
